# Grasshopper definition blossom-3d.gh (Grasshopper 1.0.7)

# SYNXROFORM
# example of  3d-blossom
srf = Surface(reparameterize(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))
v = Slider(0.843, range=0..1)
u = Slider(0.511, range=0..1)
python = GhPythonScript(sur=srf)  # -> out, res; inputs sur: Surface
# ---------- python: Python ----------
import Rhino
import Grasshopper.DataTree as dtree
import Grasshopper.Kernel.Data.GH_Path as gpath
import rhinoscriptsyntax as rs

pts = rs.SurfacePoints(sur)
cnt = rs.SurfacePointCount(sur)


res = dtree[object]()

for k in xrange(cnt[0] - 1):
    p = gpath(k)
    for j in xrange(cnt[1] - 1):
        p00 = pts[cnt[0]*j + k]
        p01 = pts[cnt[0]*j + k + 1]
        p10 = pts[cnt[0]*(j+1) + k]
        p11 = pts[cnt[0]*(j+1) + k + 1]
        
        l1 = rs.AddLine(p00, p01)
        l2 = rs.AddLine(p10, p11)
        
        s = rs.AddLoftSrf([l1, l2], loft_type=2)
        
        res.Add(s[0], p)
# ---------- end python ----------
srf_2 = Surface(reparameterize(python.res))
python_2 = GhPythonScript(grd=srf_2, u=u, v=v)  # -> out, res; inputs grd: tree of Surface
# ---------- python_2: Python ----------
import Grasshopper.DataTree as dtree
import Grasshopper.Kernel.Data.GH_Path as gpath
import rhinoscriptsyntax as rs
import rhinoscriptsyntax as rs


grd = [grd.Branch(gpath(n)) for n in xrange(grd.BranchCount)]

res = dtree[object]()

su, sv = len(grd[0]), len(grd)

for k in xrange(su - 1):
    p = gpath(k)
    for j in xrange(sv - 1):
        
        s0 = rs.EvaluateSurface(grd[j][k], u, v)
        s1 = rs.EvaluateSurface(grd[j][k+1], u, v)
        s2 = rs.EvaluateSurface(grd[j+1][k], u, v)
        s3 = rs.EvaluateSurface(grd[j+1][k+1], u, v)
        
        l1 = rs.AddLine(s0, s2)
        l2 = rs.AddLine(s1, s3)
        
        s = rs.AddLoftSrf([l1, l2], loft_type=2)
        
        res.Add(s[0], p)
# ---------- end python_2 ----------
pt = ConstructPoint(XCoordinate=u, YCoordinate=v, ZCoordinate=0)
srf_3 = Surface(reparameterize(python_2.res))
python_3 = GhPythonScript(grd=srf_3, u=u, v=v)  # -> out, res; inputs grd: tree of Surface
# ---------- python_3: Python ----------
import Grasshopper.DataTree as dtree
import Grasshopper.Kernel.Data.GH_Path as gpath
import rhinoscriptsyntax as rs
import rhinoscriptsyntax as rs


grd = [grd.Branch(gpath(n)) for n in xrange(grd.BranchCount)]

res = dtree[object]()

su, sv = len(grd[0]), len(grd)

for k in xrange(su - 1):
    p = gpath(k)
    for j in xrange(sv - 1):
        
        s0 = rs.EvaluateSurface(grd[j][k], u, v)
        s1 = rs.EvaluateSurface(grd[j][k+1], u, v)
        s2 = rs.EvaluateSurface(grd[j+1][k], u, v)
        s3 = rs.EvaluateSurface(grd[j+1][k+1], u, v)
        
        l1 = rs.AddLine(s0, s1)
        l2 = rs.AddLine(s2, s3)
        
        s = rs.AddLoftSrf([l1, l2], loft_type=2)
        
        res.Add(s[0], p)
# ---------- end python_3 ----------
evalsrf = EvaluateSurface(Surface=reparameterize(python_3.res), Point=pt)  # -> Point, Normal, UDirection, VDirection, Frame
evalsrf_2 = EvaluateSurface(Surface=srf, Point=pt)  # -> Point, Normal, UDirection, VDirection, Frame
ln = Line(StartPoint=evalsrf.Point, EndPoint=evalsrf_2.Point)
panel = Panel(ln)
